% Simulink data dictionary dictionary_axon.sldd

axon_command = Simulink.Bus()
  CMD: uint8[8 1]
  SZE: uint8[8 3]
  PYD: uint8[8 1000]

axon_command_default = Simulink.Parameter(struct(SZE=uint8(repmat(0, 8, 3)), PYD=uint8(repmat(0, 8, 1000))), StorageClass="ExportedGlobal", DataType="Bus: axon_command")  % Default value for axon_command

axon_stream = Simulink.Bus()
  SZE: uint8[8 3]
  PYD: uint8[8 1000]

axon_stream_default = Simulink.Parameter(struct(SZE=uint8(repmat(0, 8, 3)), PYD=uint8(repmat(0, 8, 1000))), StorageClass="ExportedGlobal", DataType="Bus: axon_stream")  % Default value for axon_stream